# Grasshopper definition team_06_working.gh (Grasshopper 1.0.8)
# plug-ins: Swiftlet

# ----
# Connect MCP Tools to Decall and Update All Clusters
button = Button()
# IF SOMETHING IS NOT
# WORKING PRESS THIS
# BUTTON FIRST
toggle = BooleanToggle(True)
connect_mcp_tools_to_decall = CSharpScript(nickname_From="Central MCP Server", nickname_To="Central DeCall", connect=button)  # -> out; inputs nickname_From: String, nickname_To: String, connect: Boolean
# ---------- connect_mcp_tools_to_decall: C# ----------
using System;
using System.Linq;
using Grasshopper;
using Grasshopper.Kernel;

public class Script_Instance : GH_ScriptInstance
{
    private void RunScript(string nickname_From, string nickname_To, bool connect)
    {
        if (!connect) return;
        Console.Write($"Attempting to connect outputs from '{nickname_From}' to '{nickname_To}'...");

        var ghDoc = Instances.ActiveCanvas?.Document;
        if (ghDoc == null) return;

        var compFrom = ghDoc.Objects
            .OfType<IGH_Component>()
            .FirstOrDefault(o => o.NickName == nickname_From);

        var compTo = ghDoc.Objects
            .OfType<IGH_Param>()
            .FirstOrDefault(o => o.NickName == nickname_To);

        if (compFrom != null && compTo != null)
        {
            ghDoc.ScheduleSolution(5, doc => Connect(doc, compFrom, compTo));
        }
    }

    // <Custom additional code> 
    private void Connect(GH_Document doc, IGH_Component compFrom, IGH_Param compTo)
    {
        if (compFrom == null || compTo == null) return;

        foreach (IGH_Param param in compFrom.Params.Output)
        {
            compTo.AddSource(param);
        }
    }
}
# ---------- end connect_mcp_tools_to_decall ----------
update_all_clusters = CSharpScript(update=button, recursive=toggle)  # -> out, A; inputs update: Boolean, recursive: Boolean, passwords: list of String, localPath: String
# ---------- update_all_clusters: C# ----------
using System;
using System.Collections;
using System.Collections.Generic;

using Rhino;
using Rhino.Geometry;

using Grasshopper;
using Grasshopper.Kernel;
using Grasshopper.Kernel.Data;
using Grasshopper.Kernel.Types;
using System.Windows.Forms;
using System.Linq;
/// <summary>
/// This class will be instantiated on demand by the Script component.
/// </summary>
public class Script_Instance : GH_ScriptInstance
{
  /// <summary>Print a String to the [Out] Parameter of the Script component.</summary>
  /// <param name="text">String to print.</param>
  private void Print(string text) { /* Implementation hidden. */ }
  /// <summary>Print a formatted String to the [Out] Parameter of the Script component.</summary>
  /// <param name="format">String format.</param>
  /// <param name="args">Formatting parameters.</param>
  private void Print(string format, params object[] args) { /* Implementation hidden. */ }
  /// <summary>Print useful information about an object instance to the [Out] Parameter of the Script component. </summary>
  /// <param name="obj">Object instance to parse.</param>
  private void Reflect(object obj) { /* Implementation hidden. */ }
  /// <summary>Print the signatures of all the overloads of a specific method to the [Out] Parameter of the Script component. </summary>
  /// <param name="obj">Object instance to parse.</param>
  private void Reflect(object obj, string method_name) { /* Implementation hidden. */ }

  /// <summary>Gets the current Rhino document.</summary>
  private readonly RhinoDoc RhinoDocument;
  /// <summary>Gets the Grasshopper document that owns this script.</summary>
  private readonly GH_Document GrasshopperDocument;
  /// <summary>Gets the Grasshopper script component that owns this script.</summary>
  private readonly IGH_Component Component;
  /// <summary>
  /// Gets the current iteration count. The first call to RunScript() is associated with Iteration==0.
  /// Any subsequent call within the same solution will increment the Iteration count.
  /// </summary>
  private readonly int Iteration;

  /// <summary>
  /// This procedure contains the user code. Input parameters are provided as regular arguments,
  /// Output parameters as ref arguments. You don't have to assign output parameters,
  /// they will have a default value.
  /// </summary>
  private void RunScript(
		bool update,
		bool recursive,
		List<string> passwords,
		string localPath,
		ref object A)
  {

    A = updateLog;
    if (update)
    {
      updateLog = new List<string>();
      _passwords = passwords;
      UpdateClusters(GrasshopperDocument, recursive, localPath);
    }

  }

  // <Custom additional code> 
  List<string> updateLog;
  List<String> _passwords;

  void UpdateClusters (GH_Document ghDoc, bool recursive, string localPath)
  {
    foreach (var obj in ghDoc.Objects)
    {
      var cluster = obj as Grasshopper.Kernel.Special.GH_Cluster;
      if (cluster != null)
      {
        var clusterPath = cluster.FilePath;
        if (!string.IsNullOrEmpty(clusterPath))
        {
          if (cluster.Synchronisation == Grasshopper.Kernel.Special.GH_Synchronisation.OutOfDate)
          {
            cluster.CreateFromFilePath(clusterPath);
            updateLog.Add("Updated: " + clusterPath);
          }
          else if (cluster.Synchronisation == Grasshopper.Kernel.Special.GH_Synchronisation.MissingReference)
          {
            string newPath = ReplacePath(localPath, clusterPath);
            if (!string.IsNullOrEmpty(newPath))
            {
              cluster.CreateFromFilePath(newPath);
              updateLog.Add("Replaced and updated: " + newPath);
            }
            else
            {
              updateLog.Add("Missing reference: " + clusterPath);
            }

          }
        }

        //Update recursively
        if (recursive)
        {
          GH_Document clusterDoc = GetClusterDoc(cluster);
          if (clusterDoc != null)
            UpdateClusters(clusterDoc, recursive, localPath);
        }
      }
    }
  }

  GH_Document GetClusterDoc(Grasshopper.Kernel.Special.GH_Cluster cluster)
  {
    //no pass needed
    var doc = cluster.Document(string.Empty);
    if (doc != null)
      return doc;

    //try passwords
    if (_passwords != null && _passwords.Any())
    {
      foreach (var pass in _passwords)
      {
        doc = cluster.Document(pass);
        if (doc != null)
          return doc;
      }
    }

    return null;
  }

  string ReplacePath(string localPath, string missingPath)
  {
    if (String.IsNullOrEmpty(missingPath) || string.IsNullOrEmpty(localPath))
      return null;
    else
    {
      string lastLocalPart = localPath.Split('\\').Last();
      string[] parts = missingPath.Split('\\');
      if (parts.Contains(lastLocalPart))
      {
        int i = Array.IndexOf(parts, lastLocalPart);
        string clusterPath = String.Join("\\", parts.Skip(i + 1));
        string result = String.Join("\\", localPath, clusterPath);
        return result;
      }
      else
        return null;
    }
  }
  // </Custom additional code> 
}
# ---------- end update_all_clusters ----------
panel = Panel(connect_mcp_tools_to_decall)

team_06_definition_cluster = Team06DefinitionCluster()
c_script = CSharpScript()  # -> out, availablePort
# ---------- c_script: C# ----------
// Grasshopper Script Instance
// This script finds an available port on the local machine.
#region Usings
using System;
using System.Linq;
using System.Collections;
using System.Collections.Generic;
using System.Drawing;
using System.Net;
using System.Net.Sockets;

using Rhino;
using Rhino.Geometry;

using Grasshopper;
using Grasshopper.Kernel;
using Grasshopper.Kernel.Data;
using Grasshopper.Kernel.Types;
#endregion

public class Script_Instance : GH_ScriptInstance
{
    #region Notes
    /* 
      Members:
        RhinoDoc RhinoDocument
        GH_Document GrasshopperDocument
        IGH_Component Component
        int Iteration

      Methods (Virtual & overridable):
        Print(string text)
        Print(string format, params object[] args)
        Reflect(object obj)
        Reflect(object obj, string method_name)
    */
    #endregion

    private void RunScript(object start, object end, ref object availablePort)
    {
        // Use default values if parameters are not provided
        int startPort = (start != null && int.TryParse(start.ToString(), out int s)) ? s : 3001;
        int endPort = (end != null && int.TryParse(end.ToString(), out int e)) ? e : 3100;

        // Find an available port in the specified range
        try
        {
            availablePort = FindAvailablePortInRange(startPort, endPort);
            Print($"Available port found: {availablePort}");
        }
        catch (Exception ex)
        {
            Print($"Error: {ex.Message}");
            availablePort = null;
        }
    }

    /// <summary>
    /// Checks if a local TCP port is available for binding (i.e., not in use).
    /// Returns True if available, False otherwise.
    /// </summary>
    private bool IsPortAvailableForBind(int port)
    {
        try
        {
            // Create a new TCP socket
            using (Socket socket = new Socket(AddressFamily.InterNetwork, SocketType.Stream, ProtocolType.Tcp))
            {
                // Try to bind to the port on all interfaces (0.0.0.0)
                socket.Bind(new IPEndPoint(IPAddress.Any, port));
                // If successful, the socket is closed by the using statement and return True
                return true;
            }
        }
        catch (SocketException)
        {
            // If binding fails, it means the port is already in use
            return false;
        }
    }

    /// <summary>
    /// Finds an available port by letting the OS assign one.
    /// </summary>
    private int FindAvailablePort()
    {
        Socket socket = new Socket(AddressFamily.InterNetwork, SocketType.Stream, ProtocolType.Tcp);
        socket.Bind(new IPEndPoint(IPAddress.Any, 0)); // Bind to an available port assigned by the OS
        int availablePort = ((IPEndPoint)socket.LocalEndPoint).Port; // Get the assigned port number
        socket.Close(); // Close the socket
        return availablePort;
    }

    /// <summary>
    /// Finds the first available port in a given range.
    /// </summary>
    private int FindAvailablePortInRange(int start = 3001, int end = 3100)
    {
        for (int port = start; port <= end; port++)
        {
            if (IsPortAvailableForBind(port))
                return port;
        }
        throw new Exception($"No available ports found in the range {start}-{end}.");
    }
}
# ---------- end c_script ----------
central_mcp_server = MCPServer(Port=c_script.availablePort, Tools=team_06_definition_cluster, ServerName="Swiftlet")  # -> Compute_area_of_triangular_prism, Compute_volume_of_triangular_prism, Delete_room_06, Add_window_06, Visualise_layout
panel_2 = Panel(c_script.availablePort)
get_tool_names = CSharpScript(x=team_06_definition_cluster)  # -> flatten(out)
# ---------- get_tool_names: C# ----------
// Grasshopper Script Instance
#region Usings
using System;
using System.Linq;
using System.Collections;
using System.Collections.Generic;
using System.Drawing;

using Rhino;
using Rhino.Geometry;

using Grasshopper;
using Grasshopper.Kernel;
using Grasshopper.Kernel.Data;
using Grasshopper.Kernel.Types;
#endregion

public class Script_Instance : GH_ScriptInstance
{
    #region Notes
    /* 
      Members:
        RhinoDoc RhinoDocument
        GH_Document GrasshopperDocument
        IGH_Component Component
        int Iteration

      Methods (Virtual & overridable):
        Print(string text)
        Print(string format, params object[] args)
        Reflect(object obj)
        Reflect(object obj, string method_name)
    */
    #endregion

    private void RunScript(object x)
    {
        dynamic dynamicX = x;
        Console.Write(dynamicX.Name);
    }
}
# ---------- end get_tool_names ----------
central_decall = Data([central_mcp_server.Compute_area_of_triangular_prism, central_mcp_server.Compute_volume_of_triangular_prism, central_mcp_server.Delete_room_06, central_mcp_server.Add_window_06])
clean = CleanTree(RemoveNulls=True, RemoveInvalid=True, RemoveEmpty=False, Tree=central_decall)
team_06_result_cluster = Team06ResultCluster(tool_call_request=clean)  # -> tool_names_3, tool_call_success

# ----
# Tool Names from the Results Clusters
# Tool Names from the Definition Clusters
# These Two Clusters should be EXACTLY THE SAME
panel_3 = Panel(get_tool_names)
panel_4 = Panel(team_06_result_cluster.tool_names_3)

rec = DataRecorder(team_06_result_cluster.tool_call_success, DataLimit=-10, RecordData=True)
rec_2 = DataRecorder(clean, DataLimit=-10, RecordData=True)
response_ok = Panel(rec)
called_tool_name = Panel(rec_2)

# ---- group: Request Parameters
decall = DeconstructToolCall(Request=clean)  # -> Request, Tool, Arguments
rjo = ReadJSONObject(JObject=decall.Arguments)  # -> Keys, JTokens
# Debug: Check request input data
panel_5 = Panel("room_name")
tmatch = MatchText(Text=rjo.Keys, Pattern=panel_5, Case=True)
tmatch_2 = MatchText(Text=rjo.Keys, Pattern="layout_json", Case=True)
dispatch = Dispatch(List=rjo.JTokens, DispatchPattern=tmatch)  # -> ListA, ListB
dispatch_2 = Dispatch(List=rjo.JTokens, DispatchPattern=tmatch_2)  # -> ListA, ListB
panel_6 = Panel(dispatch.ListA)
panel_7 = Panel(dispatch_2.ListA)

# ----
# Debug Tool Names
# This Panel should always be TRUE
tool_names_from_the_results_clusters = Data(panel_4)
tool_names_from_the_definition_clusters = Data(panel_3)
join = TextJoin(Text=flatten(tool_names_from_the_definition_clusters))
join_2 = TextJoin(Text=flatten(tool_names_from_the_results_clusters))
tstat = TreeStatistics(Tree=tool_names_from_the_definition_clusters)  # -> Paths, Length, Count
tstat_2 = TreeStatistics(Tree=tool_names_from_the_results_clusters)  # -> Paths, Length, Count
dpath = DeconstructPath(Branch=tstat.Paths)
dpath_2 = DeconstructPath(Branch=tstat_2.Paths)
equals = Equality(FirstNumber=tstat.Length, SecondNumber=tstat_2.Length)  # -> Equality, Inequality
equals_2 = Equality(FirstNumber=tstat.Count, SecondNumber=tstat_2.Count)  # -> Equality, Inequality
ma = MassAddition(Input=flatten(equals.Equality))  # -> Result, PartialResults
equals_3 = Equality(FirstNumber=dpath, SecondNumber=dpath_2)  # -> Equality, Inequality
lng = ListLength(List=equals.Equality)
ma_2 = MassAddition(Input=flatten(equals_3.Inequality))  # -> Result, PartialResults
equals_4 = Equality(FirstNumber=ma.Result, SecondNumber=lng)  # -> Equality, Inequality
does_quantity_of_tools_match = Panel(equals_2.Equality)
equals_5 = Equality(FirstNumber=ma_2.Result, SecondNumber="0")  # -> Equality, Inequality
does_quantity_of_tools_match_per_team = Panel(equals_4.Equality)
are_all_teams_included = Panel(equals_5.Equality)

tmatch_3 = MatchText(Text=join, Pattern=join_2, Case=True)

do_all_names_match = Panel(tmatch_3)
and = GateAnd(A=equals_5.Equality, B=equals_4.Equality, C=equals_2.Equality, D=tmatch_3)  # -> flatten(Result)
do_trees_match = Panel(and)

# ==== cluster Team06DefinitionCluster
# Team 06 Definition Cluster
# TRIANGULAR PYRAMID TEAM
panel = Panel("This tool computes the volume of an equilateral triangular prism by giving it the length of any side.  The output unit is the input unit cubed.")
panel_2 = Panel("This tool computes the area of an equilateral triangular prism by giving it the length of any side.  The output unit is the input unit squared.")
panel_3 = Panel("This tool deletes a room by giving it a room name and the layout json")
panel_4 = Panel("This tool add a window given a room name and the width of the window")
param = DefineToolParameter(Name="room_name", Type="string", Description="the name of the room", Required=Toggle(True))
param_2 = DefineToolParameter(Name="layout_schema", Type="string", Description="the layout data structure", Required=Toggle(True))
param_3 = DefineToolParameter(Name="room_name", Type="string", Description="the name of the room", Required=Toggle(True))
param_4 = DefineToolParameter(Name="layout_json", Type="string", Description="the layout data structure", Required=Toggle(True))
param_5 = DefineToolParameter(Name="layout_json", Type="string", Description="the layout data structure", Required=Toggle(True))
param_6 = DefineToolParameter(Name="length", Type="number", Description="The Length of Any Side of Triangular Prism", Required=Toggle(True))
param_7 = DefineToolParameter(Name="width", Type="number", Description="The width of the window", Required=Toggle(True))
param_8 = DefineToolParameter(Name="length", Type="number", Description="The Length of Any Side of Triangular Prism", Required=Toggle(True))
merge = Merge(Data1=param, Data2=param_4)
merge_2 = Merge(Data1=param_3, Data2=param_7, Data3=param_5)
tool = DefineTool(Name="visualise_layout", Description="This tools visulise the layout geometry given its schema", Parameters=param_2)
tool_2 = DefineTool(Name="add_window_06", Description=panel_4, Parameters=merge_2)
tool_3 = DefineTool(Name="compute_area_of_triangular_prism", Description=panel_2, Parameters=param_6)
tool_4 = DefineTool(Name="delete_room_06", Description=panel_3, Parameters=merge)
tool_5 = DefineTool(Name="compute_volume_of_triangular_prism", Description=panel, Parameters=param_8)
merge_3 = Merge(Data1=tool_5, Data2=tool_3, Data3=tool_4, Data4=tool_2, Data5=tool)
mcp_tool_list = ClusterOutput(merge_3)
py3 = Python3Script()  # -> out, a; inputs crv: list of Polyline, u: list of String, ptCirc: list of Point3d, crvBounds: Polyline, crvFacade: list of Polyline, crvCirc: list of Polyline, id: String
# ---------- py3: Python ----------
import json
from typing import List, Tuple, Dict, Any
from pathlib import Path


def polyline_to_coords(polyline) -> List[Tuple[float, float]]:
    """Convert Rhino Polyline to list of [x, y] coordinates"""
    coords = []
    for i in range(polyline.Count):
        pt = polyline[i]
        coords.append([pt.X, pt.Y])
    return coords


def point3d_to_coords(point) -> Tuple[float, float]:
    """Convert Rhino Point3d to [x, y]"""
    return [point.X, point.Y]


def line_to_coords(line) -> List[List[float]]:
    """Convert Rhino Line to [[x1, y1], [x2, y2]]"""
    return [[line.From.X, line.From.Y], [line.To.X, line.To.Y]]


def calculate_polygon_area(coords: List[List[float]]) -> float:
    """Calculate polygon area using shoelace formula"""
    if len(coords) < 3:
        return 0.0
    area = 0.0
    for i in range(len(coords) - 1):
        area += coords[i][0] * coords[i + 1][1]
        area -= coords[i + 1][0] * coords[i][1]
    return abs(area) / 2.0


def calculate_polyline_length(coords: List[List[float]]) -> float:
    """Calculate total length of a polyline"""
    if len(coords) < 2:
        return 0.0
    length = 0.0
    for i in range(len(coords) - 1):
        dx = coords[i + 1][0] - coords[i][0]
        dy = coords[i + 1][1] - coords[i][1]
        length += (dx**2 + dy**2) ** 0.5
    return round(length, 2)


def find_adjacent_rooms(door_coords: List[List[float]], rooms_coords: Dict[str, List[List[float]]]) -> List[str]:
    """Find which rooms a door connects to (simple proximity check)"""
    door_pt = door_coords[0]  # Use first point
    adjacent = []
    
    for room_id, coords in rooms_coords.items():
        # Check if door is near room boundary
        for i in range(len(coords) - 1):
            p1 = coords[i]
            p2 = coords[i + 1]
            dist = point_to_line_distance(door_pt, p1, p2)
            if dist < 0.5:  # Threshold: door within 0.5 units of boundary
                if room_id not in adjacent:
                    adjacent.append(room_id)
                break
    
    return adjacent


def point_to_line_distance(pt: List[float], p1: List[float], p2: List[float]) -> float:
    """Calculate distance from point to line segment"""
    x, y = pt
    x1, y1 = p1
    x2, y2 = p2
    
    denom = (x2 - x1) ** 2 + (y2 - y1) ** 2
    if denom == 0:
        return ((x - x1) ** 2 + (y - y1) ** 2) ** 0.5
    
    t = max(0, min(1, ((x - x1) * (x2 - x1) + (y - y1) * (y2 - y1)) / denom))
    closest_x = x1 + t * (x2 - x1)
    closest_y = y1 + t * (y2 - y1)
    
    return ((x - closest_x) ** 2 + (y - closest_y) ** 2) ** 0.5

def schema_to_desc(schema):
    """
    Convert a layout schema dict (or JSON string) to a simple description string.
    
    Args:
        schema: dict or JSON string representation of layout schema
    
    Returns format:
        "Name (ID). 1 bed, 1 bath, 1 living. Area: 600 sqft."
    """
    try:
        # If schema is a string, parse it as JSON first
        if isinstance(schema, str):
            schema = json.loads(schema)
        
        apt = schema.get("apartment", {})
        name = apt.get("name", "?")
        apt_id = apt.get("id", "?")
        area = apt.get("attributes", {}).get("area", 0)
        
        # Count rooms by program
        rooms = schema.get("rooms", [])
        room_counts = {}
        for room in rooms:
            prog = room.get("program", "?")
            room_counts[prog] = room_counts.get(prog, 0) + 1
        
        # Format room counts: "1 bed, 2 bath, 1 living"
        room_str = ", ".join([f"{count} {prog}" for prog, count in sorted(room_counts.items())])
        
        # Simple format
        desc = f"{name} (ID: {apt_id}). {room_str}. Area: {area:.0f} m2."
        return desc
    
    except:
        return "Error parsing schema"
    
def geometry_to_layout_schema(
    crvBounds,
    crv: List,
    u: List[str],
    crvFacade: List = None,
    crvCirc: List = None,
    ptCirc: List = None,
    layout_id: str = "Layout-001",
    apartment_id: str = "apartment-1",
    apartment_name: str = "Sample Apartment"
) -> Dict[str, Any]:
    """
    Convert Grasshopper geometry to extended layout schema
    
    Args:
        crvBounds: Single polyline for building outline
        crv: List of polylines for room boundaries
        u: List of room program names (e.g., ["living", "bed", "kitchen"])
        crvFacade: List of polylines for facade elements
        crvCirc: List of polylines for circulation
        ptCirc: List of Point3d for door locations
        layout_id: ID for the layout
        apartment_id: ID for the apartment
        apartment_name: Name for the apartment
    
    Returns:
        Dictionary with extended layout_schema structure
    """
    
    # Convert bounds
    outline_coords = polyline_to_coords(crvBounds)
    outline_area = calculate_polygon_area(outline_coords)
    
    # Create apartment object
    apartment = {
        "id": apartment_id,
        "name": apartment_name,
        "geometry": outline_coords,
        "attributes": {
            "area": round(outline_area, 2)
        }
    }
    
    # Process rooms
    rooms = []
    rooms_coords = {}
    
    for i, room_polyline in enumerate(crv):
        room_coords = polyline_to_coords(room_polyline)
        room_id = f"room-{i + 1}"
        rooms_coords[room_id] = room_coords
        
        room_program = u[i] if i < len(u) else "unknown"
        room_area = calculate_polygon_area(room_coords)
        
        room = {
            "id": room_id,
            "name": f"{room_program.capitalize()}",
            "program": room_program,
            "geometry": room_coords,
            "attributes": {
                "area": round(room_area, 2)
            }
        }
        rooms.append(room)
    
    # Process doors
    doors = []
    if ptCirc:
        for i, door_pt in enumerate(ptCirc):
            door_coords = [point3d_to_coords(door_pt)]
            adjacent_rooms = find_adjacent_rooms(door_coords, rooms_coords)
            
            door = {
                "id": f"door-{i + 1}",
                "name": f"Door {i + 1}",
                "geometry": door_coords,
                "attributes": {
                    "connectsRooms": adjacent_rooms
                }
            }
            doors.append(door)
    
    # Process facades
    facades = []
    if crvFacade:
        for i, facade_polyline in enumerate(crvFacade):
            facade_coords = polyline_to_coords(facade_polyline)
            facade_length = calculate_polyline_length(facade_coords)
            facade = {
                "id": f"facade-{i + 1}",
                "name": f"Facade {i + 1}",
                "geometry": facade_coords,
                "attributes": {
                    "type": "exterior",
                    "length": facade_length
                }
            }
            facades.append(facade)
    
    # Process circulation
    circulation = []
    if crvCirc:
        for i, circ_polyline in enumerate(crvCirc):
            circ_coords = polyline_to_coords(circ_polyline)
            circ_length = calculate_polyline_length(circ_coords)
            circ = {
                "id": f"circulation-{i + 1}",
                "name": f"Circulation {i + 1}",
                "geometry": circ_coords,
                "attributes": {
                    "type": "circulation",
                    "length": circ_length
                }
            }
            circulation.append(circ)
    
    # Build schema
    schema = {
        "layoutId": layout_id,
        "apartment": apartment,
        "outline": outline_coords,
        "rooms": rooms,
        "doors": doors,
        "facades": facades,
        "circulation": circulation,
        "windows": [],
        "furniture": [],
        "mep": [],
        "structure": []
    }
    description = schema_to_desc(schema)
    schema["description"] = description
    return schema


schema = geometry_to_layout_schema(
    crvBounds,
    crv,
    u,
    crvFacade,
    crvCirc,
    ptCirc,
    layout_id=id,
    apartment_id=id,
    apartment_name=name
)

a = json.dumps(schema, indent=2)
# ---------- end py3 ----------
py3_2 = Python3Script()  # -> out, a; inputs crv: list of Polyline, u: list of String, ptCirc: list of Point3d, crvBounds: Polyline, crvFacade: list of Polyline, crvCirc: list of Polyline, id: String; same code as py3

# ==== cluster Team06ResultCluster

# ----
# Team 06 Result Cluster
# TRIANGULAR PYRAMID TEAM
# Edit Tool Names to
# Match Definition Cluster
tool_names = Panel("""compute_volume_of_triangular_prism
compute_area_of_triangular_prism
delete_room_06
add_window_06
visualise_layout""")

# ----
# Sorting Logic, Please Do Not Edit
tool_call_request = ClusterInput()
tool_names_2 = Text(tool_names)
decall = DeconstructToolCall(Request=tool_call_request)  # -> Request, Tool, Arguments
mindex = MemberIndex(Set=tool_names, Member=decall.Tool)  # -> Index, Count
sift = SiftPattern(List=decall.Request, SiftPattern=mindex.Index)  # -> Output0, Output1, Output2, Output3, Output4

# ---- group: Cluster Output
tool_names_3 = ClusterOutput(tool_names_2)

# ---- group: Get the request sent from VSC Agent
decall_2 = DeconstructToolCall(Request=sift.Output3)  # -> Request, Tool, Arguments

# ----
decall_3 = DeconstructToolCall(Request=sift.Output0)  # -> Request, Tool, Arguments
decall_4 = DeconstructToolCall(Request=sift.Output1)  # -> Request, Tool, Arguments
decall_5 = DeconstructToolCall(Request=sift.Output2)  # -> Request, Tool, Arguments
gjok = GetJSONObjectKey(JObject=decall_3.Arguments, Key="length")
gjok_2 = GetJSONObjectKey(JObject=decall_4.Arguments, Key="length")
rjv = ReadJSONValue(JValue=gjok)  # -> AsString, AsNumber, AsBool
rjv_2 = ReadJSONValue(JValue=gjok_2)  # -> AsString, AsNumber, AsBool

# ---- group: Extract the tool call parameters
gjok_3 = GetJSONObjectKey(JObject=decall_2.Arguments, Key="layout_json")
gjok_4 = GetJSONObjectKey(JObject=decall_2.Arguments, Key="room_name")
gjok_5 = GetJSONObjectKey(JObject=decall_2.Arguments, Key="width")
rjv_3 = ReadJSONValue(JValue=gjok_3)  # -> AsString, AsNumber, AsBool

# ----
decall_6 = DeconstructToolCall(Request=sift.Output4)  # -> Request, Tool, Arguments
gjok_6 = GetJSONObjectKey(JObject=decall_5.Arguments, Key="layout_json")
division = Division(A=rjv.AsNumber, B="2")
division_2 = Division(A=rjv_2.AsNumber, B="2")
gjok_7 = GetJSONObjectKey(JObject=decall_5.Arguments, Key="room_name")
sqrt = SquareRoot(Value="3")
sqrt_2 = SquareRoot(Value="3")
rjv_4 = ReadJSONValue(JValue=gjok_3)  # -> AsString, AsNumber, AsBool
rjv_5 = ReadJSONValue(JValue=gjok_6)  # -> AsString, AsNumber, AsBool
rjv_6 = ReadJSONValue(JValue=gjok_5)  # -> AsString, AsNumber, AsBool
multiplication = Multiplication(A=division, B=sqrt)
multiplication_2 = Multiplication(A=division_2, B=sqrt_2)
Y = UnitY(Factor=division)
Y_2 = UnitY(Factor=division_2)
null = NullItem(Item=decall_6.Arguments)  # -> NullFlags, InvalidFlags, Description
gjok_8 = GetJSONObjectKey(JObject=decall_6.Arguments, Key="layout_schema")
not = GateNot(A=null.NullFlags)
panel = Panel(""" {
    "layoutId": "layout-1",
    "apartment": {
      "id": "layout-1",
      "name": "Sample A",
      "geometry": [
        [
          -3.088417104695468,
          -2.628440089102522
        ],
        [
          -3.088417104695468,
          2.628440089102522
        ],
        [
          3.088417104695468,
          2.628440089102522
        ],
        [
          3.088417104695468,
          -2.628440089102522
        ],
        [
          -3.088417104695468,
          -2.628440089102522
        ]
      ],
      "attributes": {
        "area": 32.47
      }
    },
    "outline": [
      [
        -3.088417104695468,
        -2.628440089102522
      ],
      [
        -3.088417104695468,
        2.628440089102522
      ],
      [
        3.088417104695468,
        2.628440089102522
      ],
      [
        3.088417104695468,
        -2.628440089102522
      ],
      [
        -3.088417104695468,
        -2.628440089102522
      ]
    ],
    "rooms": [
      {
        "id": "room-1",
        "name": "Bed",
        "program": "bed",
        "geometry": [
          [
            0.22102791658357113,
            -2.628440089102522
          ],
          [
            3.088417104695468,
            -2.628440089102522
          ],
          [
            3.088417104695468,
            0.3106338287121311
          ],
          [
            0.22102791658357113,
            0.3106338287121311
          ],
          [
            0.22102791658357113,
            -2.628440089102522
          ]
        ],
        "attributes": {
          "area": 8.43
        }
      },
      {
        "id": "room-2",
        "name": "Living",
        "program": "living",
        "geometry": [
          [
            -3.088417104695468,
            -2.628440089102522
          ],
          [
            0.22102791658357113,
            -2.628440089102522
          ],
          [
            0.22102791658357113,
            0.3106338287121311
          ],
          [
            -3.088417104695468,
            0.3106338287121311
          ],
          [
            -3.088417104695468,
            -2.628440089102522
          ]
        ],
        "attributes": {
          "area": 9.73
        }
      },
      {
        "id": "room-3",
        "name": "Kitchen",
        "program": "kitchen",
        "geometry": [
          [
            -3.088417104695468,
            0.3106338287121311
          ],
          [
            0.22102791658357113,
            0.3106338287121311
          ],
          [
            0.22102791658357113,
            2.628440089102522
          ],
          [
            -3.088417104695468,
            2.628440089102522
          ],
          [
            -3.088417104695468,
            0.3106338287121311
          ]
        ],
        "attributes": {
          "area": 7.67
        }
      },
      {
        "id": "room-4",
        "name": "Bath",
        "program": "bath",
        "geometry": [
          [
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""")
py3 = Python3Script(trigger=decall_6.Arguments, prefix="layout")  # -> random_id; inputs prefix: String
# ---------- py3: Python ----------
import random

id = random.randint(1000000, 9999999)
random_id = f"{prefix}-{id}"
# ---------- end py3 ----------
rjv_7 = ReadJSONValue(JValue=gjok_8)  # -> AsString, AsNumber, AsBool
bool = Boolean(not)

# ---- group: Delete a Space by name
py3_2 = Python3Script(json_str=rjv_5.AsString, room_name=gjok_7)  # -> out, a; inputs room_name: String
# ---------- py3_2: Python ----------
import json
import copy

# Inputs:
# json_str -> JSON as string
# room_name -> e.g. "Kitchen"

def load_json_from_string(json_string):
    try:
        data = json.loads(json_string)
    except Exception as e:
        raise ValueError(f"Invalid JSON string: {e}")
    return data

# Load JSON
data = load_json_from_string(json_str)

# Work on a copy
filtered = copy.deepcopy(data)

# ------------------------
# 1. Find room IDs to remove
# ------------------------
ids_to_remove = set()

for room in filtered.get("rooms", []):
    if room.get("name") == room_name:
        ids_to_remove.add(room.get("id"))

# ------------------------
# 2. Remove from rooms
# ------------------------
filtered["rooms"] = [
    r for r in filtered.get("rooms", [])
    if r.get("id") not in ids_to_remove
]

# ------------------------
# 3. Remove / clean DOORS
# (remove doors that connect to deleted rooms)
# ------------------------
filtered["doors"] = [
    d for d in filtered.get("doors", [])
    if not any(rid in ids_to_remove for rid in d.get("attributes", {}).get("connectsRooms", []))
]

# ------------------------
# 4. Remove WINDOWS linked to deleted rooms
# ------------------------
filtered["windows"] = [
    w for w in filtered.get("windows", [])
    if w.get("attributes", {}).get("roomId") not in ids_to_remove
]

# ------------------------
# 5. Remove FURNITURE linked to deleted rooms
# ------------------------
filtered["furniture"] = [
    f for f in filtered.get("furniture", [])
    if f.get("attributes", {}).get("roomId") not in ids_to_remove
]

# ------------------------
# 6. (Optional) MEP cleanup
# (only if tied to rooms — currently not in your schema)
# ------------------------
# Keeping all MEP elements for now

# ------------------------
# 7. STRUCTURE
# (typically global, so we keep it)
# ------------------------

# ------------------------
# Output ONLY as string
# ------------------------
a = json.dumps(filtered, indent=2)
# ---------- end py3_2 ----------

# ---- group: Get a Specific Room
py3_3 = Python3Script(json_str=rjv_3.AsString, room_name=gjok_4)  # -> out, a; inputs room_name: String
# ---------- py3_3: Python ----------
import json
import Rhino.Geometry as rg

# Inputs:
# json_str -> JSON as string
# room_name -> e.g. "Living Room"

def load_json_from_string(json_string):
    try:
        data = json.loads(json_string)
    except Exception as e:
        raise ValueError(f"Invalid JSON string: {e}")
    return data

def create_polyline(points):
    pts = [rg.Point3d(x, y, 0) for x, y in points]

    # Ensure closed
    if pts[0] != pts[-1]:
        pts.append(pts[0])

    return rg.Polyline(pts).ToPolylineCurve()

# Load JSON
data = load_json_from_string(json_str)

# Find the room
room_curve = None

for room in data.get("rooms", []):
    if room.get("name") == room_name:
        geometry = room.get("geometry")
        if geometry:
            room_curve = create_polyline(geometry)
        break

# Output ONLY the polyline
a = room_curve
# ---------- end py3_3 ----------

# ----
X = UnitX(Factor=multiplication)
X_2 = UnitX(Factor=multiplication_2)
rev = Reverse(Vector=Y)
rev_2 = Reverse(Vector=Y_2)
sphere_name = Panel(py3)
pjs = ParseJSONString(Text=py3_2.a)
py3_4 = Python3Script(schema_str=rjv_7.AsString)  # -> out, outline, rooms, programs, doors, facades, circulation
# ---------- py3_4: Python ----------
import json
from typing import List, Dict, Any
import Rhino.Geometry as rg

def load_json_from_string(json_string):
    try:
        data = json.loads(json_string)
    except Exception as e:
        raise ValueError(f"Invalid JSON string: {e}")
    return data

def _coords_to_geometry(coords: List[List[float]]):
    """Convert coords to Rhino Polyline (or Line if 2 points)."""
    
    if len(coords) == 2:
        p1 = rg.Point3d(coords[0][0], coords[0][1], 0.0)
        p2 = rg.Point3d(coords[1][0], coords[1][1], 0.0)
        return rg.Line(p1, p2)
    
    points = [rg.Point3d(c[0], c[1], 0.0) for c in coords]
    return rg.Polyline(points)


def schema_to_rhino_geometry(schema: Dict[str, Any]) -> Dict[str, Any]:
    """ Convert layout schema to Rhino geometry objects for Grasshopper. """
    
    if isinstance(schema, str):
        schema = json.loads(schema)
    
    result = {
        "outline": _coords_to_geometry(schema.get("outline", [])),
        "rooms": [],
        "programs": [],
        "doors": [],
        "facades": [],
        "circulation": []
    }
    
    # Rooms
    for room in schema.get("rooms", []):
        result["rooms"].append(_coords_to_geometry(room.get("geometry", [])))
        result["programs"].append(room.get("program", "unknown"))
    
    # Doors (points only)
    for door in schema.get("doors", []):
        door_coords = door.get("geometry", [[0, 0]])
        pt_coords = door_coords[0] if isinstance(door_coords[0], list) else door_coords
        result["doors"].append(rg.Point3d(pt_coords[0], pt_coords[1], 0.0))
    
    # Facades
    for facade in schema.get("facades", []):
        result["facades"].append(_coords_to_geometry(facade.get("geometry", [])))
    
    # Circulation
    for circ in schema.get("circulation", []):
        result["circulation"].append(_coords_to_geometry(circ.get("geometry", [])))
    
    return result

schema = load_json_from_string(schema_str)
geom = schema_to_rhino_geometry(schema)
outline = geom["outline"]
rooms = geom["rooms"]
programs = geom["programs"]
doors = geom["doors"]
facades = geom["facades"]
circulation = geom["circulation"]
# ---------- end py3_4 ----------
pt = ConstructPoint(XCoordinate=0, YCoordinate=0, ZCoordinate=0)
pt_2 = ConstructPoint(XCoordinate=0, YCoordinate=0, ZCoordinate=0)
merge = Merge(Data1=Y, Data2=rev, Data3=X)
merge_2 = Merge(Data1=Y_2, Data2=rev_2, Data3=X_2)
move = Move(Geometry=pt, Motion=merge)  # -> Geometry, Transform
move_2 = Move(Geometry=pt_2, Motion=merge_2)  # -> Geometry, Transform
division_3 = Division(A=rjv_6.AsNumber, B="2")

# ---- group: Design Logic to Add a Window
room_polyline = Data(py3_3.a)
debrep = DeconstructBrep(Brep=room_polyline)  # -> Faces, Edges, Vertices
item = ListItem(List=debrep.Edges, Index=0, Wrap=True)
midpt = CurveMiddle(Curve=item)
X_3 = UnitX(Factor=division_3)
move_3 = Move(Geometry=midpt, Motion=expr("-x", X_3))  # -> Geometry, Transform
move_4 = Move(Geometry=midpt, Motion=X_3)  # -> Geometry, Transform
merge_3 = Merge(Data1=move_4.Geometry, Data2=move_3.Geometry)

# ----
respond = MCPToolResponse(Request=decall_5.Request, Content=pjs, IsError=False)
merge_4 = Merge(
    Data1=py3_4.outline,
    Data2=py3_4.rooms,
    Data3=py3_4.programs,
    Data4=py3_4.doors,
    Data5=py3_4.facades,
    Data6=py3_4.circulation)
py3_5 = Python3Script(geometry=merge_4, name=sphere_name, bake=bool)  # -> result, error; inputs geometry: GeometryBase, name: String, bake: Boolean
# ---------- py3_5: Python ----------
import Rhino
import scriptcontext as sc
import System
import json

if bake:
    error = True
    sc.doc = Rhino.RhinoDoc.ActiveDoc
    
    obj_id = sc.doc.Objects.Add(geometry)
    
    if obj_id != System.Guid.Empty:
        obj = sc.doc.Objects.Find(obj_id)
        if obj:
            attr = obj.Attributes.Duplicate()
            attr.Name = name
            sc.doc.Objects.ModifyAttributes(obj_id, attr, True)
            
            # Debug: check bounding box and geometry type
            bbox = obj.Geometry.GetBoundingBox(True)
            geo_type = obj.Geometry.GetType().Name
            result = json.dumps({
                "name": name,
                "type": geo_type
            })
            error = False
        else:
            result = json.dumps({"err" : "Object not found after add"})
        
        sc.doc.Views.Redraw()
    else:
        result = json.dumps({"err" : "Failed to bake geometry"})
    
    sc.doc = ghdoc
else:
    result = json.dumps({"msg" : "Bake is False, skipping"})
    error = False
# ---------- end py3_5 ----------
item_2 = ListItem(List=move.Geometry, Index="0", Wrap=True)
item_3 = ListItem(List=move.Geometry, Index="1", Wrap=True)
item_4 = ListItem(List=move.Geometry, Index="2", Wrap=True)
item_5 = ListItem(List=move_2.Geometry, Index="0", Wrap=True)
item_6 = ListItem(List=move_2.Geometry, Index="1", Wrap=True)
item_7 = ListItem(List=move_2.Geometry, Index="2", Wrap=True)
pjs_2 = ParseJSONString(Text=py3_5.result)
srf4pt = _4PointSurface(CornerA=item_2, CornerB=item_3, CornerC=item_4)
srf4pt_2 = _4PointSurface(CornerA=item_5, CornerB=item_6, CornerC=item_7)

# ---- group: Creates a Window Object
txt = Text(merge_3)
window_object = Python3Script(element_id="window-2", name="South Window", geometry=txt)  # -> out, window_obj; inputs element_id: String, geometry: list
# ---------- window_object: Python ----------
import json

def parse_point_string(pt_str):
    """
    Converts '{3.5, 0, 0}' -> [3.5, 0.0]
    """
    # Remove braces and spaces
    cleaned = pt_str.strip().replace("{", "").replace("}", "")
    
    # Split into components
    parts = cleaned.split(",")
    
    if len(parts) < 2:
        raise ValueError(f"Invalid point format: {pt_str}")
    
    x = float(parts[0])
    y = float(parts[1])
    
    return [x, y]

def serialize_geometry(geometry_list):
    """
    Converts list of GH strings into [[x,y], [x,y]]
    """
    return [parse_point_string(pt) for pt in geometry_list]

# ------------------------
# Convert geometry
# ------------------------
serialized_geometry = serialize_geometry(geometry)

# Build window object
window_obj = {
    "id": element_id,
    "name": name,
    "geometry": serialized_geometry
}

# Optional attributes
if attributes:
    window_obj["attributes"] = attributes

# Output ONLY as JSON string
window_obj = json.dumps(window_obj, indent=2)
# ---------- end window_object ----------

# ----
respond_2 = MCPToolResponse(Request=decall_6.Request, Content=pjs_2, IsError=py3_5.error)
pcen = PolygonCenter(Polyline=srf4pt)  # -> CenterV, CenterE, CenterA
pcen_2 = PolygonCenter(Polyline=srf4pt_2)  # -> CenterV, CenterE, CenterA

# ---- group: Merge it to the original layout json
py3_6 = Python3Script(json_str=rjv_3.AsString, new_object=window_object.window_obj)  # -> out, updated_layout
# ---------- py3_6: Python ----------
import json
import copy

def load_json_from_string(json_string):
    try:
        return json.loads(json_string)
    except Exception as e:
        raise ValueError(f"Invalid JSON string: {e}")

def detect_object_type(obj):
    """
    Infer target list from object id prefix.
    """
    obj_id = obj.get("id", "").lower()

    if obj_id.startswith("window"):
        return "windows"
    elif obj_id.startswith("door"):
        return "doors"
    elif obj_id.startswith("furn") or obj_id.startswith("furniture"):
        return "furniture"
    elif obj_id.startswith("mep"):
        return "mep"
    elif obj_id.startswith("wall") or obj_id.startswith("structure"):
        return "structure"
    else:
        # default fallback (safe choice)
        return "windows"

# ------------------------
# Load inputs
# ------------------------
layout = load_json_from_string(json_str)
new_object = json.loads(new_object)  # assuming object comes as JSON string

# Work on copy
updated = copy.deepcopy(layout)

# ------------------------
# Detect target category
# ------------------------
target_key = detect_object_type(new_object)

# ------------------------
# Ensure list exists
# ------------------------
if target_key not in updated:
    updated[target_key] = []

# ------------------------
# Insert object
# ------------------------
updated[target_key].append(new_object)

# ------------------------
# Output JSON string
# ------------------------
updated_layout = json.dumps(updated, indent=2)
# ---------- end py3_6 ----------

# ----
avr = Average(Input=pcen.CenterV)
avr_2 = Average(Input=pcen_2.CenterV)
Z = UnitZ(Factor=multiplication)
Z_2 = UnitZ(Factor=multiplication_2)
merge_5 = Merge(Data1=flatten(py3_2.a), Data2=flatten(py3_6.updated_layout))
pjs_3 = ParseJSONString(Text=py3_6.updated_layout)
move_5 = Move(Geometry=avr, Motion=Z)  # -> Geometry, Transform
move_6 = Move(Geometry=avr_2, Motion=Z_2)  # -> Geometry, Transform
respond_3 = MCPToolResponse(Request=decall_2.Request, Content=pjs_3, IsError=False)
extr = ExtrudePoint(Base=srf4pt, Point=move_5.Geometry)
extr_2 = ExtrudePoint(Base=srf4pt_2, Point=move_6.Geometry)

# ---- group: Extractor Tool do map json to grasshopper data
extractor = Python3Script(json_str=merge_5)  # -> out, outline_curve, room_names, room_curves, door_names, door_curves, window_names, window_curves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
# ---------- extractor: Python ----------
import json
import Rhino.Geometry as rg

def load_json_from_string(json_string):
    try:
        data = json.loads(json_string)
    except Exception as e:
        raise ValueError(f"Invalid JSON string: {e}")
    return data

def create_polyline(points, close=True):
    """Create a Rhino PolylineCurve from 2D points"""
    pts = [rg.Point3d(x, y, 0) for x, y in points]

    if close and pts[0] != pts[-1]:
        pts.append(pts[0])

    return rg.Polyline(pts).ToPolylineCurve()

def create_line(points):
    """Create a Rhino LineCurve from 2 points"""
    if len(points) != 2:
        return None
    p1 = rg.Point3d(points[0][0], points[0][1], 0)
    p2 = rg.Point3d(points[1][0], points[1][1], 0)
    return rg.LineCurve(p1, p2)

# Load JSON
layout = load_json_from_string(json_str)

# ------------------------
# ROOMS (polygons)
# ------------------------
room_names = []
room_curves = []

for room in layout.get("rooms", []):
    name = room.get("name")
    geometry = room.get("geometry")

    if name and geometry:
        curve = create_polyline(geometry, close=True)
        room_names.append(name)
        room_curves.append(curve)

# ------------------------
# DOORS (lines)
# ------------------------
door_names = []
door_curves = []

for door in layout.get("doors", []):
    name = door.get("name")
    geometry = door.get("geometry")

    if name and geometry:
        curve = create_line(geometry)
        if curve:
            door_names.append(name)
            door_curves.append(curve)

# ------------------------
# WINDOWS (lines)
# ------------------------
window_names = []
window_curves = []

for window in layout.get("windows", []):
    name = window.get("name")
    geometry = window.get("geometry")

    if name and geometry:
        curve = create_line(geometry)
        if curve:
            window_names.append(name)
            window_curves.append(curve)

# ------------------------
# FURNITURE (polygons)
# ------------------------
furniture_names = []
furniture_curves = []

for furn in layout.get("furniture", []):
    name = furn.get("name")
    geometry = furn.get("geometry")

    if name and geometry:
        curve = create_polyline(geometry, close=True)
        furniture_names.append(name)
        furniture_curves.append(curve)

# ------------------------
# MEP (polygons)
# ------------------------
mep_names = []
mep_curves = []

for m in layout.get("mep", []):
    name = m.get("name")
    geometry = m.get("geometry")

    if name and geometry:
        curve = create_polyline(geometry, close=True)
        mep_names.append(name)
        mep_curves.append(curve)

# ------------------------
# STRUCTURE (lines)
# ------------------------
structure_names = []
structure_curves = []

for s in layout.get("structure", []):
    name = s.get("name")
    geometry = s.get("geometry")

    if name and geometry:
        curve = create_line(geometry)
        if curve:
            structure_names.append(name)
            structure_curves.append(curve)

# ------------------------
# OUTLINE (optional)
# ------------------------
outline_curve = None
if "outline" in layout:
    outline_curve = create_polyline(layout["outline"], close=True)

# ------------------------
# OUTPUTS
# ------------------------
a = room_names
b = room_curves

c = door_names
d = door_curves

e = window_names
f = window_curves

g = furniture_names
h = furniture_curves

i = mep_names
j = mep_curves

k = structure_names
l = structure_curves

m = outline_curve
# ---------- end extractor ----------

# ----
cap = CapHoles(Brep=extr)
cap_2 = CapHoles(Brep=extr_2)
area = Area(Geometry=cap_2)  # -> Area, Centroid
volume = Volume(Geometry=cap)  # -> Volume, Centroid
panel_2 = Panel(area.Area)
panel_3 = Panel(volume.Volume)

# ---- group: Polylines
srf = Surface(extractor.room_curves)
preview = CustomPreview(Geometry=srf, Material=[ColourSwatch(SwatchColor=RGB(167, 219, 44)), ColourSwatch(SwatchColor=RGB(4, 154, 184))])

# ---- group: Windows
data = Data(extractor.window_curves)
previewlw = CustomPreviewLineweights(Geometry=data, Shader=ColourSwatch(SwatchColor=RGB(56, 56, 56)), Thickness=Slider(5.4, range=0..10), Absolute=False)

# ----
cjv = CreateJSONValue(Value=panel_3)
cjv_2 = CreateJSONValue(Value=panel_2)

# ---- group: Labels
area_2 = Area(Geometry=srf)  # -> Area, Centroid
tag = TextTag(Location=area_2.Centroid, Text=extractor.room_names)

# ----
cjo = CreateJSONObject(Keys="volume", Values=cjv)
cjo_2 = CreateJSONObject(Keys="area", Values=cjv_2)
respond_4 = MCPToolResponse(Request=decall_3.Request, Content=cjo, IsError=False)
respond_5 = MCPToolResponse(Request=decall_4.Request, Content=cjo_2, IsError=False)
or = GateOr(A=respond_4, B=respond_5, C=respond, D=respond_3, E=respond_2)
tool_call_success = ClusterOutput(or)
